# Grasshopper definition testCurves.gh (Grasshopper 1.0.7)
# plug-ins: Parakeet, RoboDK plugin for Rhino

rectangle = Rectangle(Plane=PlaneXY(0, 0, 0), XSize=Domain(-1, 1), YSize=Domain(-2, 2), Radius=0)  # -> Rectangle, Length
cymatics = CymaticPattern(N=50, M=Slider(28, range=0..100), Length=100, Tolerance=0.01)
boundary = BoundarySurfaces(Edges=rectangle.Rectangle)
crv = Curve([<curve referenced from the Rhino model> x13])
reb = RebuildCurve(Curve=cymatics, Degree=Slider(1, range=0..1), Count=Slider(15, range=0..100), Tangents=False)
crv2rob = CurveS2Robot(
    Curve=reb,
    Surface=boundary,
    Name="pattern",
    AdditionalInputs=0,
    CheckCollisions=False,
    CreatePoints=False,
    CurveZigZag=True,
    InvertNormals=False,
    NameObject="RhinoCrv",
    RDK_COM=-1,
    RDK_RhinoDefaults=True,
    Scale=1,
    ToleranceDEG=5,
    ToleranceMM=0.25,
    Type=1,
    UpdateLevel=2)  # -> Status, Message
